# Grasshopper definition DTS_coil_SVG_Generator.gh (Grasshopper 1.0.8)

# Use these boolean parameters to toggle certain aspects of the code on and off
auxilary_ring_width_mm = Slider(20, range=10..70)
# Use these sliders to adjust numerical input parameters. The changing geometry can be viewed in real time in the rhino window by selecting the block at the top.
# these parameters relate to general coil geometry and resolution
coil_radius_mm = Slider(100, range=0..500)
coil_length_mm = Slider(500, range=100..1000)
number_of_windings = Slider(100, range=0..200)
# these parameters relate to more specific frame geometries, such as ribs, rings, ground stakes, luster terminals and DTS cable
number_of_ribs = Slider(12, range=1..20)
rib_width_mm = Slider(17, range=3..30)
dts_fiber_margin_mm = Slider(11, range=7..20)
number_of_support_rings_excluding_bottom = Slider(3, range=0..10)  # "number of support rings (excluding bottom ring)"
support_ring_width_mm = Slider(18, range=4..40)
polygon_smoothing_radius_mm = Slider(50, range=0..200)
ring_distance_from_edge_mm = Slider(5.7, range=0..10)
glassfiber_radius_mm = Slider(0.8, range=0.1..2)
luster_terminal_length_mm = Slider(6.2, range=0..10)
luster_terminal_width_mm = Slider(5.8, range=0..10)
stake_length_mm = Slider(50, range=0..200)
# these parameters relate to the laser cutting process
material_thickness_mm = Slider(3.4, range=0..10)
kerf_mm = Slider(0.1, range=0..2)
# This sets the spacing between parts
parts_distance_mm = Slider(1, range=0..1)
# These parameters are optional and can be used to split support rings and support ribs into sections. This allows for coil geometries which exceed the laser cutter workarea limitations, in addition to more efficient material use.
number_of_rib_sections = Slider(1, range=1..5)
rib_split_spacing_mm = Slider(7, range=0..10)
rib_section_cut_depth = Slider(6, range=0..10)
h_connector_width = Slider(9, range=0..40)
number_of_ring_sections = Slider(4, range=1..8)
ring_section_cut_depth = Slider(7, range=0..10)
ring_section_separation_spacing_mm = Slider(29, range=5..200)
include_luster_terminals = BooleanToggle(True)
generate_auxiliary_ring = BooleanToggle(False)
include_bottom_ring = BooleanToggle(True)
split_stake = BooleanToggle(True)
# Set the 'full calc' parameter to true to generate the 'full' SVG file. This may take a while (for a large number of ribs and a large number of windings this can be up to 30 minutes).
# 
# Select 'final SVG' to see the final result. Right click and select 'bake...' to export the curve into the rhino whindow. Make sure the 'full calc' parameter has been set to 'true' before baking.
full_calc = BooleanToggle(False)
# For the curious user: double click this cluster to view and modify the file generation script, which consists of a collection of clusters.
svg_generation_cluster = SVG_generation_cluster(
    relay=coil_radius_mm,
    relay_2=number_of_ribs,
    relay_3=kerf_mm,
    relay_4=coil_length_mm,
    relay_5=rib_width_mm,
    relay_6=glassfiber_radius_mm,
    relay_7=number_of_windings,
    P=full_calc,
    relay_8=parts_distance_mm,
    relay_9=dts_fiber_margin_mm,
    relay_10=support_ring_width_mm,
    relay_11=number_of_support_rings_excluding_bottom,
    relay_12=material_thickness_mm,
    relay_13=ring_distance_from_edge_mm,
    relay_14=stake_length_mm,
    relay_15=polygon_smoothing_radius_mm,
    relay_16=luster_terminal_length_mm,
    relay_17=luster_terminal_width_mm,
    relay_18=auxilary_ring_width_mm,
    relay_19=number_of_rib_sections,
    relay_20=rib_split_spacing_mm,
    relay_21=rib_section_cut_depth,
    relay_22=h_connector_width,
    relay_23=number_of_ring_sections,
    relay_24=ring_section_cut_depth,
    relay_25=ring_section_separation_spacing_mm,
    relay_26=split_stake,
    relay_27=include_luster_terminals,
    relay_28=include_bottom_ring,
    relay_29=generate_auxiliary_ring)  # -> final_ribs_2, dts_cuts_2, S, final_rings_2, auxiliary_ring_2
select_this_block_to_see_a_rough_preview = Curve([svg_generation_cluster.final_ribs_2, svg_generation_cluster.dts_cuts_2, svg_generation_cluster.final_rings_2, svg_generation_cluster.auxiliary_ring_2])  # "Select this block to see a rough preview of the final path in the rhino window"
final_svg = Curve(svg_generation_cluster.S)

# ==== cluster SVG_generation_cluster
relay = ClusterInput()
relay_2 = ClusterInput()
relay_3 = ClusterInput()
relay_4 = ClusterInput()
relay_5 = ClusterInput()
relay_6 = ClusterInput()
relay_7 = ClusterInput()
relay_8 = ClusterInput()
relay_9 = ClusterInput()
relay_10 = ClusterInput()
relay_11 = ClusterInput()
relay_12 = ClusterInput()
relay_13 = ClusterInput()
relay_14 = ClusterInput()
relay_15 = ClusterInput()
relay_16 = ClusterInput()
relay_17 = ClusterInput()
relay_18 = ClusterInput()
relay_19 = ClusterInput()
relay_20 = ClusterInput()
relay_21 = ClusterInput()
relay_22 = ClusterInput()
relay_23 = ClusterInput()
relay_24 = ClusterInput()
relay_25 = ClusterInput()
relay_26 = ClusterInput()
relay_27 = ClusterInput()
relay_28 = ClusterInput()
relay_29 = ClusterInput()
generate_support_ring = GenerateSupportRing(
    number_of_support_ribs=relay_2,
    polygon_smoothing_radius=relay_15,
    coil_radius=relay,
    kerf=relay_3,
    rib_width=relay_5,
    support_ring_thickness=relay_10)  # -> polygon_x_size, rbig, T
calc_rib_lengths = CalcRibLengths(kerf=relay_3, rib_width=relay_5, dts_margin=relay_9, len_coil=relay_4)  # -> riblen_x, riblen_y, riblenwithkerf
generate_rib_cut = GenerateRibCut(rib_length_x=calc_rib_lengths.riblen_x, kerf=relay_3, material_thickness=relay_12, ring_distance_from_edge=relay_13)  # -> half_x_min_kerf, rectangle_3, single_cutout, material_thickness_min_kerf
generate_dts_cutout = GenerateDTSCutout(dts_radius=relay_6, kerf=relay_3)
generate_luster_terminal = GenerateLusterTerminal(kerf=relay_3, kroonsteen_breedte=relay_16, kroonsteen_lengte=relay_17, include_kroonsteen=relay_27)
luster_terminal_cutout = Curve(generate_luster_terminal)
generate_auxiliary_support_ring = GenerateAuxiliarySupportRing(
    number_of_support_ribs=relay_2,
    polygon_smoothing_radius=relay_15,
    coil_radius=relay,
    kerf_2=relay_3,
    rib_width=relay_5,
    support_ring_thickness=relay_18,
    polygon_x_size=generate_support_ring.polygon_x_size,
    rib_length_x=calc_rib_lengths.riblen_x,
    number_of_ribs=relay_2,
    kerf=relay_3,
    rbig=generate_support_ring.rbig,
    material_thickness=relay_12,
    half_x_min_kerf=generate_rib_cut.half_x_min_kerf,
    ring_distance_to_edge=relay_13,
    material_thickness_min_kerf=generate_rib_cut.material_thickness_min_kerf)
generate_rib_cutout_array = GenerateRibCutoutArray(
    single_cutout=generate_rib_cut.single_cutout,
    material_thickness_min_kerf=generate_rib_cut.material_thickness_min_kerf,
    riblen_y=calc_rib_lengths.riblenwithkerf,
    num_support_rings=relay_11,
    P=relay_28)
generate_ring_cutout = GenerateRingCutout(
    polygon_x_size=generate_support_ring.polygon_x_size,
    number_of_ribs=relay_2,
    crv=generate_rib_cut.rectangle_3,
    rbig=generate_support_ring.rbig,
    half_x_min_kerf=generate_rib_cut.half_x_min_kerf,
    material_thickness_min_kerf=generate_rib_cut.material_thickness_min_kerf)
generate_dts_cutout_array = GenerateDTSCutoutArray(
    dts_cutout=generate_dts_cutout,
    parts_distance=relay_8,
    dts_radius=relay_6,
    rib_length_y=calc_rib_lengths.riblenwithkerf,
    num_turns=relay_7,
    number_of_ribs=relay_2,
    riblen_x=calc_rib_lengths.riblen_x,
    number_of_turns=relay_4)  # -> crv_2, dts_spacing_vector, O
generate_rib = GenerateRib(stake_legnth=relay_14, targetsize_x=calc_rib_lengths.riblen_x, targetsize_y=calc_rib_lengths.riblen_y)  # -> targetsize_y_3, R
auxiliary_support_ring = Geometry(generate_auxiliary_support_ring)
reposition_bottom_luster_terminal = RepositionBottomLusterTerminal(single_cutout=luster_terminal_cutout, kr_x=relay_16, kr_y=relay_17, rib_y=relay_4, dts_fiber_margin=relay_9)
reposition_top_luster_terminal = RepositionTopLusterTerminal(
    kerf=relay_3,
    single_cutout=luster_terminal_cutout,
    kr_x=relay_16,
    part_interspacing=relay_8,
    rib_width=calc_rib_lengths.riblen_x,
    num_ribs=relay_2,
    dts_radius=relay_6,
    kr_y=relay_17,
    rib_y=relay_4,
    dts_margin=relay_9)
move_aux_ring = MoveAuxRing(O=auxiliary_support_ring, ringsize=generate_support_ring.rbig, ribsize=relay_5, parts_dist=relay_8)
ring_cutout_array = Curve(generate_ring_cutout)
ring = Curve(generate_support_ring.T)
rdiff = RegionDifference(CurvesA=generate_rib.R, CurvesB=generate_rib_cutout_array)
rdiff_2 = RegionDifference(CurvesA=ring, RingCutout=ring_cutout_array)
dts_cuts = Curve(generate_dts_cutout_array.O)
single_strut = Geometry(rdiff)
ungroup = Ungroup(Group=move_aux_ring)
dts_cuts_2 = ClusterOutput(dts_cuts)
single_cutout_ring = Curve(rdiff_2)
P = ClusterInput()
arrlinear = LinearArray(Geometry=single_strut, Direction=generate_dts_cutout_array.dts_spacing_vector, Count=relay_2)  # -> Geometry, Transform
make_ring_array = MakeRingArray(
    ring_cut_depth=relay_24,
    kerf=relay_3,
    ring_separation_spacing=relay_25,
    n_ring_sections=relay_23,
    num_ribs=relay_2,
    G=single_cutout_ring,
    parts_distance=relay_8,
    riblen_dts_margin=calc_rib_lengths.riblen_y,
    A=relay_11,
    rbig=generate_support_ring.rbig,
    bottom_ring=relay_28)
boolean_split_control = Dispatch(List=dts_cuts, DispatchPattern=P)  # -> ListA, ListB
ribs = Curve(arrlinear.Geometry)
flatten = FlattenTree(Tree=ribs, Path="{0}")
graft = GraftTree(Tree=flatten, IncludeEmptyLists=True, IncludeNullItems=True)
simplify = SimplifyTree(Tree=graft, Front=False)
simplify_2 = SimplifyTree(Tree=boolean_split_control.ListA, Front=False)
auxiliary_ring = Geometry(ungroup)
rdiff_3 = RegionDifference(CurvesA=simplify, CurvesB=simplify_2)
include_aux_ring = StreamGate(Stream=auxiliary_ring, Gate=relay_29)  # -> Target0, Target1
bottom_luster_terminal = Curve(reposition_bottom_luster_terminal)
top_luster_terminal = Curve(reposition_top_luster_terminal)
split_ribs = SplitRibs(
    rib_crv=rdiff_3,
    x=relay_2,
    part_spacing=relay_8,
    rib_width=calc_rib_lengths.riblen_x,
    num_sections=relay_19,
    riblen=generate_rib.targetsize_y_3,
    split_spacing=relay_20,
    h_width=relay_22,
    bot_luster_terminal=bottom_luster_terminal,
    cut_depth=relay_21,
    top_luster_terminal=top_luster_terminal,
    material_thickness=relay_12,
    kerf=relay_3,
    split_stake=relay_26,
    luster_width=relay_17,
    h_depth=relay_21,
    stake_length=relay_14)
final_rings = Curve(make_ring_array)
auxiliary_ring_2 = ClusterOutput(include_aux_ring.Target1)
final_ribs = Curve(split_ribs)
final_rings_2 = ClusterOutput(final_rings)
final_ribs_2 = ClusterOutput(final_ribs)
total_shape = Curve([final_ribs, final_rings, include_aux_ring.Target1])
explode = Explode(Curve=[final_rings, include_aux_ring.Target1, final_ribs], Recursive=True)  # -> Segments, Vertices
S = ClusterOutput(explode.Segments)

# ==== cluster GenerateRib
stake_legnth = ClusterInput()
targetsize_x = ClusterInput()
targetsize_y = ClusterInput()
square = Curve(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)
targetsize_x_2 = Number(targetsize_x)
targetsize_y_2 = Number(targetsize_y)
stake_base_v2 = Geometry(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)
expression = Expression(stake_length=stake_legnth, Expression="stake_length>0")
check_bbox_size = CheckBboxSize(C=square)  # -> R, R_2
scale_value_x = Division(A=targetsize_x_2, B=check_bbox_size.R)
scale_value_y = Division(A=targetsize_y_2, B=check_bbox_size.R_2)
stake_legnth_2 = Number(stake_legnth)
check_bbox_size_2 = CheckBboxSize(C=stake_base_v2)  # -> R, R_2
scale_value_y_2 = Division(A=stake_legnth_2, B=check_bbox_size_2.R_2)
scale_value_x_2 = Division(A=targetsize_x_2, B=check_bbox_size_2.R)
scale_nu = ScaleNU(Geometry=square, Plane=PlaneXY(0, 0, 0), ScaleX=scale_value_x, ScaleY=scale_value_y, ScaleZ=1)  # -> Geometry, Transform
num = Number(2)
division = Division(A=targetsize_y_2, B=num)
scale_nu_2 = ScaleNU(Geometry=stake_base_v2, Plane=PlaneXY(0, 0, 0), ScaleX=scale_value_x_2, ScaleY=scale_value_y_2, ScaleZ=1)  # -> Geometry, Transform
vec = VectorXYZ(XComponent=0, YComponent=division, ZComponent=0)  # -> Vector, Length
move = Move(Geometry=scale_nu_2.Geometry, Motion=vec.Vector)  # -> Geometry, Transform
runion = RegionUnion(Curves=[scale_nu.Geometry, move.Geometry])
p_n_c = PickNChoose(IncludeStake=expression, Stream0=scale_nu.Geometry, Stream1=runion)
targetsize_y_3 = ClusterOutput(targetsize_y_2)
R = ClusterOutput(p_n_c)

# ==== cluster CalcRibLengths
len_coil = ClusterInput()
two = Number(2)
dts_margin = ClusterInput()
kerf = ClusterInput()
multiplication = Multiplication(DTSMargin=dts_margin, B=two)
multiplication_2 = Multiplication(Kerf=kerf, B=two)
addition = Addition(Len_coil=len_coil, Kerf=multiplication_2)
rib_width = ClusterInput()
addition_2 = Addition(Kerf=multiplication_2, RibWidth=rib_width)
riblenwithkerf = ClusterOutput(addition)
addition_3 = Addition(A=addition, B=multiplication)
riblen_x = ClusterOutput(addition_2)
riblen_y = ClusterOutput(addition_3)

# ==== cluster GenerateDTSCutout
dts_radius = ClusterInput()
kerf = ClusterInput()
subtraction = Subtraction(DTSRadius=dts_radius, Kerf=kerf)
cir = Circle(Plane=PlaneXY(0, 0, 0), Radius=subtraction)
dts_cross_section = ClusterOutput(cir)

# ==== cluster GenerateDTSCutoutArray
rib_length_y = ClusterInput()
num_turns = ClusterInput()
number_of_ribs = ClusterInput()
dts_radius = ClusterInput()
parts_distance = ClusterInput()
riblen_x = ClusterInput()
dts_cutout = ClusterInput()
number_of_turns = ClusterInput()
division = Division(RibLengthY=rib_length_y, NumTurns=num_turns)
Y = UnitY(Factor=division)
arrlinear = LinearArray(DTSCutout=dts_cutout, Direction=Y, NumTurns=num_turns)  # -> Geometry, Transform
eval = Evaluate(F="-0.5*riblen_y", riblen_y=rib_length_y)
eval_2 = Evaluate(F="0.5*riblen_x", riblen_x=riblen_x)
vec = VectorXYZ(XComponent=eval_2, YComponent=eval, ZComponent=0)  # -> Vector, Length
move = Move(Geometry=arrlinear.Geometry, Motion=vec.Vector)  # -> Geometry, Transform
addition = Addition(RibLengthX=riblen_x, PartsDistance=parts_distance, DTSRadius=dts_radius)
group = Group(Objects=move.Geometry)
series = Series(Start=0, Step=1, NumberOfRibs=number_of_ribs)
X = UnitX(Factor=addition)
crv = Curve(move.Geometry)
arrlinear_2 = LinearArray(Geometry=group, Direction=X, NumberOfRibs=number_of_ribs)  # -> DTSCutoutArray, Transform
eval_3 = Evaluate(F="((coillen/turnnum)/ribnum)*set", turnnum=num_turns, ribnum=number_of_ribs, coillen=number_of_turns, set=series)
crv_2 = ClusterOutput(crv)
dts_spacing_vector = ClusterOutput(X)
vec_2 = VectorXYZ(XComponent=0, YComponent=eval_3, ZComponent=0)  # -> Vector, Length
move_2 = Move(Geometry=arrlinear_2.DTSCutoutArray, Motion=vec_2.Vector)  # -> Geometry, Transform
ungroup = Ungroup(Group=move_2.Geometry)
O = ClusterOutput(ungroup)

# ==== cluster GenerateRibCut
kerf = ClusterInput()
material_thickness = ClusterInput()
rib_length_x = ClusterInput()
kerf_2 = Number(kerf)
ring_distance_from_edge = ClusterInput()
num = Number(2)
num_2 = Number(2)
num_3 = Number(2)
division = Division(RibLengthX=rib_length_x, B=num_3)
multiplication = Multiplication(Kerf=kerf_2, B=num)
division_2 = Division(RingDistance=ring_distance_from_edge, B=num_2)
subtraction = Subtraction(MaterialThickness=material_thickness, B=multiplication)
subtraction_2 = Subtraction(A=division, B=division_2)
subtraction_3 = Subtraction(A=subtraction_2, B=kerf_2)
eval = Evaluate(F="-x-kerf", x=division, kerf=kerf_2)
half_x_min_kerf = ClusterOutput(subtraction_3)
rectangle = Rectangle(Plane=PlaneXY(0, 0, 0), XSize=subtraction_3, YSize=subtraction, Radius=0)  # -> Rectangle, Length
vec = VectorXYZ(XComponent=eval, YComponent=0, ZComponent=0)  # -> Vector, Length
rectangle_2 = Curve(rectangle.Rectangle)
rectangle_3 = ClusterOutput(rectangle_2)
material_thickness_min_kerf = ClusterOutput(subtraction)
move = Move(Geometry=rectangle_2, Motion=vec.Vector)  # -> SingleCutout, Transform
single_cutout = ClusterOutput(move.SingleCutout)

# ==== cluster GenerateRibCutoutArray
single_cutout = ClusterInput()
riblen_y = ClusterInput()
P = ClusterInput()
single_cutout_2 = Curve(single_cutout)
riblen_y_2 = Number(riblen_y)
num_support_rings = ClusterInput()
division = Division(RiblenY=riblen_y_2, NumSupportRings=num_support_rings)
num = Number(0.5)
multiplication = Multiplication(RiblenY=riblen_y_2, B=num)
material_thickness_min_kerf = ClusterInput()
Y = UnitY(Factor=division)
subtraction = Subtraction(A=multiplication, MaterialThicknessMinKerf=material_thickness_min_kerf)
arrlinear = LinearArray(SingleCutout=single_cutout_2, Direction=Y, NumSupportRings=num_support_rings)  # -> Geometry, Transform
eval = Evaluate(F="-0.5*riblen_y", riblen_y=riblen_y_2)
Y_2 = UnitY(Factor=subtraction)
vec = VectorXYZ(XComponent=0, YComponent=eval, ZComponent=0)  # -> Vector, Length
move = Move(Geometry=arrlinear.Geometry, Motion=vec.Vector)  # -> Geometry, Transform
move_2 = Move(SingleCutout=single_cutout_2, Motion=Y_2)  # -> Geometry, Transform
join = JoinCurves(Curves=[move_2.Geometry, move.Geometry], Preserve=False)
group = Group(Objects=join)
group_2 = Group(Objects=move.Geometry)
p_n_c = PickNChoose(Pattern=P, Stream0=group_2, Stream1=group)
ungroup = Ungroup(Group=p_n_c)
flatten = FlattenTree(Tree=ungroup, Path="{0}")
rib_cuts_array = Curve(flatten)
rib_cuts_array_2 = ClusterOutput(rib_cuts_array)

# ==== cluster GenerateSupportRing
kerf = ClusterInput()
rib_width = ClusterInput()
polygon_smoothing_radius = ClusterInput()
two = Number(2)
coil_radius = ClusterInput()
kerf_2 = Number(kerf)
division = Division(RibWidth=rib_width, B=two)
number_of_support_ribs = ClusterInput()
support_ring_thickness = ClusterInput()
addition = Addition(CoilRadius=coil_radius, B=division)
subtraction = Subtraction(A=addition, SupportRingThickness=support_ring_thickness)
subtraction_2 = Subtraction(A=subtraction, Kerf=kerf_2)
addition_2 = Addition(A=addition, Kerf=kerf_2)
polygon = Polygon(
    Plane=PlaneXY(0, 0, 0),
    Radius=addition_2,
    NumberOfSupportRibs=number_of_support_ribs,
    PolygonSmoothingRadius=polygon_smoothing_radius)  # -> Polygon, Length
polygon_2 = Polygon(Plane=PlaneXY(0, 0, 0), Radius=subtraction_2, Segments=number_of_support_ribs, FilletRadius=polygon_smoothing_radius)  # -> Polygon, Length
rbig = ClusterOutput(addition_2)
join = JoinCurves(Curves=[polygon.Polygon, polygon_2.Polygon], Preserve=False)
bbox = BoundingBox(Content=polygon.Polygon, Plane=PlaneXY(0, 0, 0))  # -> Box, Box_2
graft = GraftTree(Tree=join, IncludeEmptyLists=True, IncludeNullItems=True)
debox = DeconstructBox(Box=bbox.Box)  # -> Plane, PolygonSize, Y, Z
dedomain = DeconstructDomain(Domain=debox.PolygonSize)  # -> Start, PolygonXSize
polygon_x_size = ClusterOutput(dedomain.PolygonXSize)
T = ClusterOutput(graft)

# ==== cluster GenerateRingCutout
_0_5 = Number(-0.5)
material_thickness_min_kerf = ClusterInput()
crv = ClusterInput()
rbig = ClusterInput()
half_x_min_kerf = ClusterInput()
number_of_ribs = ClusterInput()
polygon_x_size = ClusterInput()
crv_2 = Curve(crv)
multiplication = Multiplication(MaterialThicknessMinKerf=material_thickness_min_kerf, B=_0_5)
subtraction = Subtraction(Rbig=rbig, HalfXMinKerf=half_x_min_kerf)
subtraction_2 = Subtraction(A=subtraction)
mirror = Mirror(Geometry=crv_2, Plane=PlaneYZ(0, 0, 0))  # -> Geometry, Transform
vec = VectorXYZ(PolygonXSize=polygon_x_size, YComponent=multiplication, ZComponent=0)  # -> Vector, Length
move = Move(RectangleCutout=mirror.Geometry, Motion=vec.Vector)  # -> Geometry, Transform
arrpolar = PolarArray(Geometry=move.Geometry, Plane=PlaneXY(0, 0, 0), NumberOfRibs=number_of_ribs, Angle=6.283185307)  # -> RingCutoutArray, Transform
ring_cutout_array = ClusterOutput(arrpolar.RingCutoutArray)

# ==== cluster MakeRingArray
num_ribs = ClusterInput()
G = ClusterInput()
py3 = Python3Script(num_ribs=num_ribs)  # -> out, a
# ---------- py3: Python ----------
import numpy as np

a=(np.pi)/num_ribs
# ---------- end py3 ----------
n_ring_sections = ClusterInput()
rotate = Rotate(Geometry=G, Angle=py3.a, Plane=PlaneXY(0, 0, 0))  # -> Geometry, Transform
A = ClusterInput()
bottom_ring = ClusterInput()
pt = ConstructPoint(XCoordinate=0, YCoordinate=0, ZCoordinate=0)
bottom_ring_2 = Boolean(bottom_ring)
parts_distance = ClusterInput()
riblen_dts_margin = ClusterInput()
add_extra_ring_for_bottom = Addition(A=A, B=bottom_ring_2)
parts_distance_2 = Number(parts_distance)
py3_2 = Python3Script(N_ring_sections=n_ring_sections, N_ribs=num_ribs)  # -> out, a, b
# ---------- py3_2: Python ----------
import numpy as np

def find_closest_intersections(ideal_angles, possible_intersections):
    return possible_intersections[np.abs(possible_intersections[:, None] - ideal_angles).argmin(axis=0)]

increment=2*np.pi/N_ribs
possible_intersections=np.arange(0, 2*np.pi, increment)
ideal_angle=2*np.pi/N_ring_sections
ideal_angles=np.array(range(N_ring_sections))*ideal_angle
closest_intersections = find_closest_intersections(ideal_angles, possible_intersections)
a=list(closest_intersections)



n=np.array(range(N_ring_sections))
n=np.roll(n, -1)
print(n)
print(360/N_ring_sections)
rotate_angles=-np.array(n)*((2*np.pi)/N_ring_sections)-np.pi/N_ring_sections
blst=list(rotate_angles)+list(np.flip(rotate_angles))
b=[float(x) for x in blst]
print(b)
# ---------- end py3_2 ----------
_2 = Number(2)
rbig = ClusterInput()
pt_2 = ConstructPoint(XCoordinate=rbig, YCoordinate=0, ZCoordinate=0)
ln = Line(StartPoint=pt, EndPoint=pt_2)
ring_cut_depth = ClusterInput()
kerf = ClusterInput()
division = Division(RiblenDTSMargin=riblen_dts_margin, B=_2)
rbig_2 = Number(rbig)
rotate_2 = Rotate(Geometry=ln, Angle=py3_2.a, Plane=PlaneXY(0, 0, 0))  # -> Geometry, Transform
num = Number(0)
addition = Addition(Rbig=rbig_2, B=division, PartsDistance=parts_distance_2)
ccx = CurveCurve(CurveA=rotate.Geometry, CurveB=rotate_2.Geometry)  # -> Points, ParamsA, ParamsB
item = ListItem(List=flatten(ccx.Points), Index=num, Wrap=True)
item_2 = ListItem(List=flatten(ccx.Points), Index=n_ring_sections, Wrap=True)
eval = Evaluate(E="ring_cut_depth+kerf", ring_cut_depth=ring_cut_depth, kerf=kerf)
_2_2 = Number(2)
eval_2 = Evaluate(E="ring_cut_depth-kerf", ring_cut_depth=ring_cut_depth, kerf=kerf)
dist = Distance(PointA=item, PointB=item_2)
division_2 = Division(A=dist, B=3)
eval_3 = Evaluate(E="(ring_width-material_thickness)/2-kerf", ring_width=dist, material_thickness=division_2, kerf=kerf)
eval_4 = Evaluate(E="x_in+2*kerf+material_thickness", material_thickness=division_2, kerf=kerf, x_in=eval_3)
eval_5 = Evaluate(E="(ring_width-material_thickness)/2+kerf", ring_width=dist, material_thickness=division_2, kerf=kerf)
eval_6 = Evaluate(E="x_in-2*kerf+material_thickness", material_thickness=division_2, kerf=kerf, x_in=eval_5)
crv_cp = CurveClosestPoint(Point=flatten(ccx.Points), Curve=rotate.Geometry)  # -> Point, Parameter, Distance
neg = Negative(Value=addition)
py3_3 = Python3Script(N_sections=n_ring_sections)  # -> out, a, b, c
# ---------- py3_3: Python ----------
import numpy as np
rangelist=range(N_sections)

lst=list(rangelist)+list(-1*np.array(rangelist).astype(int)-1)
a=[int(x) for x in lst]
print(a)

lst=list(rangelist)
b=[int(x) for x in lst]
print(b)

indices = []

for i in range(N_sections):
    indices.append(i)
    indices.append(2*N_sections-i-1)
print(indices)
c=indices
# ---------- end py3_3 ----------
multiplication = Multiplication(Rbig=rbig_2, B=_2_2)
Y = UnitY(Factor=neg)
move = Move(SingleRing=rotate.Geometry, Motion=Y)  # -> Geometry, Transform
shatter = Shatter(Curve=flatten(rotate.Geometry), Parameters=crv_cp.Parameter)  # -> flatten(Segments)
pt_3 = ConstructPoint(XCoordinate=0, YCoordinate=0, ZCoordinate=0)
pt_4 = ConstructPoint(XCoordinate=eval_3, YCoordinate=0, ZCoordinate=0)
pt_5 = ConstructPoint(XCoordinate=eval_3, YCoordinate=eval, ZCoordinate=0)
pt_6 = ConstructPoint(XCoordinate=eval_4, YCoordinate=eval, ZCoordinate=0)
pt_7 = ConstructPoint(XCoordinate=eval_4, YCoordinate=0, ZCoordinate=0)
pt_8 = ConstructPoint(XCoordinate=dist, YCoordinate=0, ZCoordinate=0)
pt_9 = ConstructPoint(XCoordinate=0, YCoordinate=0, ZCoordinate=0)
pt_10 = ConstructPoint(XCoordinate=eval_5, YCoordinate=0, ZCoordinate=0)
pt_11 = ConstructPoint(XCoordinate=eval_5, YCoordinate=eval_2, ZCoordinate=0)
pt_12 = ConstructPoint(XCoordinate=eval_6, YCoordinate=eval_2, ZCoordinate=0)
pt_13 = ConstructPoint(XCoordinate=eval_6, YCoordinate=0, ZCoordinate=0)
pt_14 = ConstructPoint(XCoordinate=dist, YCoordinate=0, ZCoordinate=0)
addition_2 = Addition(PartsDistance=parts_distance_2, B=multiplication)
ln_2 = Line(StartPoint=pt_3, EndPoint=pt_4)
ln_3 = Line(StartPoint=pt_4, EndPoint=pt_5)
ln_4 = Line(StartPoint=pt_5, EndPoint=pt_6)
ln_5 = Line(StartPoint=pt_6, EndPoint=pt_7)
ln_6 = Line(StartPoint=pt_7, EndPoint=pt_8)
item_3 = ListItem(List=shatter, Index=py3_3.a, Wrap=True)
ln_7 = Line(StartPoint=pt_9, EndPoint=pt_10)
ln_8 = Line(StartPoint=pt_10, EndPoint=pt_11)
ln_9 = Line(StartPoint=pt_11, EndPoint=pt_12)
ln_10 = Line(StartPoint=pt_12, EndPoint=pt_13)
ln_11 = Line(StartPoint=pt_13, EndPoint=pt_14)
neg_2 = Negative(Value=py3_3.b)
X = UnitX(Factor=addition_2)
arrlinear = LinearArray(Geometry=move.Geometry, Direction=X, NumberOfRings=add_extra_ring_for_bottom)  # -> RingArray, Transform
rotate_3 = Rotate(Geometry=item_3, Angle=py3_2.b, Plane=PlaneXY(0, 0, 0))  # -> Geometry, Transform
neg_3 = Negative(Value=py3_3.b)
join = JoinCurves(Curves=[ln_2, ln_3, ln_4, ln_5, ln_6], Preserve=False)
subtraction = Subtraction(A=neg_2, B=1)
mirror = Mirror(Geometry=rotate_3.Geometry, Plane=PlaneYZ(0, 0, 0))  # -> Geometry, Transform
join_2 = JoinCurves(Curves=[ln_7, ln_8, ln_9, ln_10, ln_11], Preserve=False)
subtraction_2 = Subtraction(A=neg_3, B=1)
male = Curve(join)
end = EndPoints(Curve=mirror.Geometry)  # -> Start, End
female = Curve(join_2)
item_4 = ListItem(List=end.Start, Index=subtraction, Wrap=True)
item_5 = ListItem(List=end.Start, Index=py3_3.b, Wrap=True)
item_6 = ListItem(List=end.End, Index=subtraction_2, Wrap=True)
item_7 = ListItem(List=end.End, Index=py3_3.b, Wrap=True)
pt_15 = ConstructPoint(XCoordinate=0, YCoordinate=0, ZCoordinate=0)
ring_separation_spacing = ClusterInput()
vec2pt = Vector2Pt(PointA=item_4, PointB=item_5, Unitize=False)  # -> Vector, Length
vec2pt_2 = Vector2Pt(PointA=pt_15, PointB=item_5, Unitize=False)  # -> Vector, Length
vec2pt_3 = Vector2Pt(PointA=item_6, PointB=item_7, Unitize=False)  # -> Vector, Length
vec2pt_4 = Vector2Pt(PointA=pt_15, PointB=item_7, Unitize=False)  # -> Vector, Length
X_2 = UnitX(Factor=1)
move_2 = Move(Geometry=female, Motion=vec2pt_2.Vector)  # -> Geometry, Transform
move_3 = Move(Geometry=male, Motion=vec2pt_4.Vector)  # -> Geometry, Transform
X_3 = UnitX(Factor=1)
angle = Angle(VectorA=vec2pt.Vector, VectorB=X_2)  # -> Angle, Reflex
angle_2 = Angle(VectorA=vec2pt_3.Vector, VectorB=X_3)  # -> Angle, Reflex
eval_7 = Evaluate(E="x-pi", x=angle.Angle)
eval_8 = Evaluate(E="x-pi", x=angle_2.Angle)
neg_4 = Negative(Value=eval_7)
rotate_4 = Rotate(Geometry=move_3.Geometry, Angle=eval_8, Plane=item_7)  # -> Geometry, Transform
rotate_5 = Rotate(Geometry=move_2.Geometry, Angle=neg_4, Plane=item_5)  # -> Geometry, Transform
py3_4 = Python3Script(num_sections=n_ring_sections, ring_separation_spacing=ring_separation_spacing)  # -> out, a, b
# ---------- py3_4: Python ----------
import numpy as np

arr=np.array(range(num_sections))*ring_separation_spacing
mirrored_arr = arr[::-1]
lst=list(arr)+list(mirrored_arr)
a=[float(x) for x in lst]
print(a)

b=np.array(range(num_sections))*ring_separation_spacing
lst=list(b)
b=[float(x) for x in lst]
# ---------- end py3_4 ----------
X_4 = UnitX(Factor=py3_4.b)
X_5 = UnitX(Factor=py3_4.b)
move_4 = Move(Geometry=rotate_4.Geometry, Motion=X_4)  # -> Geometry, Transform
move_5 = Move(Geometry=rotate_5.Geometry, Motion=X_5)  # -> Geometry, Transform
X_6 = UnitX(Factor=py3_4.a)
move_6 = Move(Geometry=mirror.Geometry, Motion=X_6)  # -> Geometry, Transform
crv = Curve([move_6.Geometry, move_5.Geometry, move_4.Geometry])
move_7 = Move(SingleRing=crv, Motion=Y)  # -> Geometry, Transform
multiplication_2 = Multiplication(A=n_ring_sections, B=ring_separation_spacing)
X_7 = UnitX(Factor=multiplication_2)
arrlinear_2 = LinearArray(Geometry=move_7.Geometry, Direction=X_7, NumberOfRings=add_extra_ring_for_bottom)  # -> RingArray, Transform
expression = Expression(x=n_ring_sections, Expression="x>1")
filter = StreamFilter(Gate=expression, Stream0=arrlinear.RingArray, Stream1=arrlinear_2.RingArray)
s_1 = ClusterOutput(filter)

# ==== cluster SplitRibs
h_width = ClusterInput()
material_thickness = ClusterInput()
cut_depth = ClusterInput()
riblen = ClusterInput()
kerf = ClusterInput()
split_spacing = ClusterInput()
rib_width = ClusterInput()
num_sections = ClusterInput()
rib_crv = ClusterInput()
x = ClusterInput()
part_spacing = ClusterInput()
eval = Evaluate(E="int(x)", x=x)
addition = Addition(A=num_sections, B=1)
split_stake = ClusterInput()
luster_width = ClusterInput()
stake_length = ClusterInput()
h_depth = ClusterInput()
split_stake_2 = Boolean(split_stake)
expression = Expression(stake_length=stake_length, H_depth=h_depth, Expression="0.5*stake_length>2*H_depth")
division = Division(H_connector_width=h_width, B=2)
eval_2 = Evaluate(E="cut_depth*2+kerf", cut_depth=cut_depth, material_thickness=material_thickness, kerf=kerf)
eval_3 = Evaluate(E="cut_depth+kerf", cut_depth=cut_depth, material_thickness=material_thickness, kerf=kerf)
eval_4 = Evaluate(E="(x+luster_width)/2+H_depth", x=riblen, luster_width=luster_width, H_depth=h_depth)
eval_5 = Evaluate(E="num_ribs*(x+part_spacing)+5", x=rib_width, num_ribs=x, part_spacing=part_spacing)
half_h_connector_width = Number(division)
neg = Negative(Value=rib_width)
Y = UnitY(Factor=eval_4)
pt = ConstructPoint(XCoordinate=0, YCoordinate=eval_3, ZCoordinate=0)
eval_6 = Evaluate(F="riblen/num_sections", num_sections=num_sections, riblen=riblen)
pt_2 = ConstructPoint(XCoordinate=eval_5, YCoordinate=0, ZCoordinate=0)
pt_3 = ConstructPoint(XCoordinate=neg, YCoordinate=0, ZCoordinate=0)
subtraction = Subtraction(A=num_sections, B=1)
# Generate H-pieces
addition_2 = Addition(A=half_h_connector_width, B=kerf)
eval_7 = Evaluate(E="material_thickness/2-kerf", cut_depth=cut_depth, material_thickness=material_thickness, kerf=kerf, H_width=addition_2)
pt_4 = ConstructPoint(XCoordinate=addition_2, YCoordinate=0, ZCoordinate=0)
pt_5 = ConstructPoint(XCoordinate=addition_2, YCoordinate=eval_2, ZCoordinate=0)
pt_6 = ConstructPoint(XCoordinate=eval_7, YCoordinate=eval_2, ZCoordinate=0)
pt_7 = ConstructPoint(XCoordinate=eval_7, YCoordinate=eval_3, ZCoordinate=0)
ln = Line(StartPoint=pt_4, EndPoint=pt_5)
ln_2 = Line(StartPoint=pt_5, EndPoint=pt_6)
ln_3 = Line(StartPoint=pt_6, EndPoint=pt_7)
ln_4 = Line(StartPoint=pt_7, EndPoint=pt)
ln_5 = Line(StartPoint=pt_2, EndPoint=pt_3)
move = Move(Geometry=ln_5, Motion=Y)  # -> Geometry, Transform
Y_2 = UnitY(Factor=eval_6)
crv = Curve([ln_3, ln, ln_2, ln_4])
and = GateAnd(A=split_stake_2, B=expression)
filter = StreamFilter(Gate=and, Stream0=num_sections, Stream1=addition)
num_sections_2 = Number(filter)
xz = XZPlane(Origin=Point(0, 0, 0))
crv_2 = Curve(reparameterize(rib_crv))
eval_8 = Evaluate(E="H_width+part_spacing", H_width=h_width, part_spacing=part_spacing)
eval_9 = Evaluate(E="2*H_height+part_spacing", H_height=eval_2, part_spacing=part_spacing)
eval_10 = Evaluate(F="-0.5*riblen+section_length", riblen=riblen, section_length=eval_6)
arrlinear = LinearArray(Geometry=ln_5, Direction=Y_2, Count=subtraction)  # -> Geometry, Transform
mirror = Mirror(Geometry=crv, Plane=PlaneYZ(0, 0, 0))  # -> Geometry, Transform
mirror_2 = Mirror(Geometry=[crv, mirror.Geometry], Plane=xz)  # -> Geometry, Transform
subtraction_2 = Subtraction(A=num_sections_2, B=1)
filter_2 = StreamFilter(Gate=and, Stream1=move.Geometry)
graft = GraftTree(Tree=crv_2, IncludeEmptyLists=True, IncludeNullItems=True)
rectangle = Rectangle(Plane=PlaneXY(0, 0, 0), XSize=eval_8, YSize=eval_9, Radius=0)  # -> Rectangle, Length
h_connector = Curve([crv, mirror.Geometry, mirror_2.Geometry])
Y_3 = UnitY(Factor=eval_10)
move_2 = Move(Geometry=arrlinear.Geometry, Motion=Y_3)  # -> Geometry, Transform
eval_11 = Evaluate(E="-unit_width*N-rib_width", unit_width=eval_8, N=eval, rib_width=rib_width)
arrbox = BoxArray(Geometry=h_connector, Cell=rectangle.Rectangle, XCount=eval, YCount=subtraction_2, ZCount=2)  # -> Geometry, Transform
split_spacing_mm = Number(split_spacing)
X = UnitX(Factor=eval_11)
slx = SurfaceLine(Surface=graft, Line=flatten([move_2.Geometry, filter_2]), LimitToFirst=False)  # -> Curves, Points, UVPoints, Normal
py3 = Python3Script(spacing=split_spacing_mm, N=num_sections_2, num_sections=num_sections_2)  # -> vector_array, a
# ---------- py3: Python ----------
import numpy as np

output = range(int(num_sections))
output=list(np.array(output)*spacing)
print(output)
a=output
# ---------- end py3 ----------
move_3 = Move(Geometry=arrbox.Geometry, Motion=X)  # -> Geometry, Transform
srfsplit = SurfaceSplit(Surface=flatten(graft), Curves=flatten(slx.Curves))
Y_4 = UnitY(Factor=py3.a)
bbox = BoundingBox(Content=srfsplit, Plane=PlaneXY(0, 0, 0))  # -> Box, Box_2
debox = DeconstructBox(Box=bbox.Box)  # -> Plane, X, Y, Z
# Generate rib notches
eval_12 = Evaluate(E="(rib_width-material_thickness)/2+kerf", rib_width=rib_width, material_thickness=material_thickness, kerf=kerf)
eval_13 = Evaluate(E="x_in-2*kerf+material_thickness", rib_width=rib_width, material_thickness=material_thickness, kerf=kerf, x_in=eval_12)
eval_14 = Evaluate(E="cut_depth-kerf", cut_depth=cut_depth, kerf=kerf)
dedomain = DeconstructDomain(Domain=debox.Y)  # -> Start, End
sort = SortList(Keys=dedomain.Start, ValuesA=srfsplit)  # -> Keys, ValuesA
pt_8 = ConstructPoint(XCoordinate=0, YCoordinate=0, ZCoordinate=0)
pt_9 = ConstructPoint(XCoordinate=eval_12, YCoordinate=0, ZCoordinate=0)
pt_10 = ConstructPoint(XCoordinate=eval_12, YCoordinate=eval_14, ZCoordinate=0)
pt_11 = ConstructPoint(XCoordinate=eval_13, YCoordinate=eval_14, ZCoordinate=0)
pt_12 = ConstructPoint(XCoordinate=eval_13, YCoordinate=0, ZCoordinate=0)
pt_13 = ConstructPoint(XCoordinate=rib_width, YCoordinate=0, ZCoordinate=0)
move_4 = Move(Geometry=sort.ValuesA, Motion=Y_4)  # -> Geometry, Transform
debrep = DeconstructBrep(Brep=move_4.Geometry)  # -> Faces, Edges, Vertices
ln_6 = Line(StartPoint=pt_8, EndPoint=pt_9)
ln_7 = Line(StartPoint=pt_9, EndPoint=pt_10)
ln_8 = Line(StartPoint=pt_10, EndPoint=pt_11)
ln_9 = Line(StartPoint=pt_11, EndPoint=pt_12)
ln_10 = Line(StartPoint=pt_12, EndPoint=pt_13)
join = JoinCurves(Curves=debrep.Edges, Preserve=False)
crv_3 = Curve(debrep.Edges)
eval_15 = Evaluate(E="-width/2", width=rib_width)
join_2 = JoinCurves(Curves=[ln_6, ln_7, ln_8, ln_9, ln_10], Preserve=False)
bbox_2 = BoundingBox(Content=join, Plane=PlaneXY(0, 0, 0))  # -> Box, Box_2
X_2 = UnitX(Factor=eval_15)
debox_2 = DeconstructBox(Box=bbox_2.Box)  # -> Plane, X, Y, Z
move_5 = Move(Geometry=join_2, Motion=X_2)  # -> Geometry, Transform
bbox_3 = BoundingBox(Content=move_5.Geometry, Plane=PlaneXY(0, 0, 0))  # -> Box, Box_2
debox_3 = DeconstructBox(Box=bbox_3.Box)  # -> Plane, X, Y, Z
dedomain_2 = DeconstructDomain(Domain=debox_2.X)  # -> Start, End
dedomain_3 = DeconstructDomain(Domain=debox_2.Y)  # -> Start, End
dedomain_4 = DeconstructDomain(Domain=debox_3.X)  # -> Start, End
dedomain_5 = DeconstructDomain(Domain=debox_3.Y)  # -> Start, End
pt_14 = ConstructPoint(XCoordinate=dedomain_2.Start, YCoordinate=dedomain_3.Start, ZCoordinate=0)
pt_15 = ConstructPoint(XCoordinate=dedomain_2.Start, YCoordinate=dedomain_3.End, ZCoordinate=0)
pt_16 = ConstructPoint(XCoordinate=dedomain_4.Start, YCoordinate=dedomain_5.Start, ZCoordinate=0)
py3_2 = Python3Script(num_sections=num_sections_2, num_ribs=eval)  # -> out, a
# ---------- py3_2: Python ----------
import numpy as np
length=int(num_sections*num_ribs)
a=[]
index_array=(np.array(range(int(length/num_sections)))*int(num_sections))

for i in range(len(index_array)):
    a.append(int(index_array[i]+num_sections-1))

a=list(a)
# ---------- end py3_2 ----------
py3_3 = Python3Script(num_sections=num_sections_2, num_ribs=eval)  # -> out, a
# ---------- py3_3: Python ----------
import numpy as np
length=int(num_sections*num_ribs)
a=[]
index_array=(np.array(range(int(length/num_sections)))*int(num_sections))

for i in range(len(index_array)):
    a.append(int(index_array[i]))

a=list(a)
# ---------- end py3_3 ----------
bot_luster_terminal = ClusterInput()
top_luster_terminal = ClusterInput()
flatten = FlattenTree(Tree=pt_14, Path="{0}")
flatten_2 = FlattenTree(Tree=pt_15, Path="{0}")
cull_i = CullIndex(List=flatten, Indices=py3_3.a, Wrap=True)
# Move luster terminal
bot_luster_terminal_2 = Curve(bot_luster_terminal)
top_luster_terminal_2 = Curve(top_luster_terminal)
cull_i_2 = CullIndex(List=flatten_2, Indices=py3_2.a, Wrap=True)
expression_2 = Expression(x=num_sections_2, Expression="x>1")
xz_2 = XZPlane(Origin=Point(0, 0, 0))
vec2pt = Vector2Pt(PointA=pt_16, PointB=cull_i_2, Unitize=False)  # -> Vector, Length
subtraction_3 = Subtraction(A=num_sections, B=1)
vec2pt_2 = Vector2Pt(PointA=pt_16, PointB=cull_i, Unitize=False)  # -> Vector, Length
filter_3 = StreamFilter(Gate=expression_2, Stream0=crv_2)
mirror_3 = Mirror(Geometry=move_5.Geometry, Plane=xz_2)  # -> Geometry, Transform
multiplication = Multiplication(A=split_spacing_mm, B=subtraction_3)
move_6 = Move(Geometry=move_5.Geometry, Motion=vec2pt_2.Vector)  # -> Geometry, Transform
move_7 = Move(Geometry=mirror_3.Geometry, Motion=vec2pt.Vector)  # -> Geometry, Transform
Y_5 = UnitY(Factor=multiplication)
crv_4 = Curve([move_6.Geometry, move_7.Geometry, join])
move_8 = Move(Geometry=bot_luster_terminal_2, Motion=Y_5)  # -> Geometry, Transform
crv_5 = Curve([crv_4, move_8.Geometry, top_luster_terminal_2, move_3.Geometry])
crv_6 = ClusterOutput(crv_5)

# ==== cluster MoveAuxRing
parts_dist = ClusterInput()
ringsize = ClusterInput()
ribsize = ClusterInput()
O = ClusterInput()
eval = Evaluate(F="-(ringsize+0.5*ribsize)-parts_dist-200", ringsize=ringsize, ribsize=ribsize, parts_dist=parts_dist)
group = Group(Objects=O)
vec = VectorXYZ(XComponent=eval, YComponent=0, ZComponent=0)  # -> Vector, Length
move = Move(SingleRing=group, Motion=vec.Vector)  # -> Geometry, Transform
aux_ring = ClusterOutput(move.Geometry)

# ==== cluster GenerateAuxiliarySupportRing
rib_length_x = ClusterInput()
kerf = ClusterInput()
material_thickness = ClusterInput()
ring_distance_to_edge = ClusterInput()
generate_rib_cut = GenerateRibCut_2(
    rib_length_x=rib_length_x,
    kerf=kerf,
    material_thickness=material_thickness,
    ring_distance_from_edge=ring_distance_to_edge)  # -> half_x_min_kerf, rectangle_3, single_cutout, material_thickness_min_kerf
number_of_support_ribs = ClusterInput()
polygon_smoothing_radius = ClusterInput()
coil_radius = ClusterInput()
kerf_2 = ClusterInput()
rib_width = ClusterInput()
support_ring_thickness = ClusterInput()
generate_support_ring = GenerateSupportRing_2(
    number_of_support_ribs=number_of_support_ribs,
    polygon_smoothing_radius=polygon_smoothing_radius,
    coil_radius=coil_radius,
    kerf=kerf_2,
    rib_width=rib_width,
    support_ring_thickness=support_ring_thickness)  # -> polygon_x_size, rbig, T
polygon_x_size = ClusterInput()
number_of_ribs = ClusterInput()
rbig = ClusterInput()
half_x_min_kerf = ClusterInput()
material_thickness_min_kerf = ClusterInput()
generate_ring_cutout = GenerateRingCutout_2(
    polygon_x_size=polygon_x_size,
    number_of_ribs=number_of_ribs,
    crv=generate_rib_cut.rectangle_3,
    rbig=rbig,
    half_x_min_kerf=half_x_min_kerf,
    material_thickness_min_kerf=material_thickness_min_kerf)
ring_cutout_array = Curve(generate_ring_cutout)
ring = Curve(generate_support_ring.T)
rdiff = RegionDifference(CurvesA=ring, RingCutout=ring_cutout_array)
ring_2 = ClusterOutput(rdiff)

# ==== cluster GenerateLusterTerminal
kroonsteen_lengte = ClusterInput()
kerf = ClusterInput()
include_kroonsteen = ClusterInput()
num = Number(2)
multiplication = Multiplication(Kerf=kerf, B=num)
subtraction = Subtraction(KroonsteenLengte=kroonsteen_lengte, B=multiplication)
kroonsteen_breedte = ClusterInput()
include_kroonsteen_2 = Boolean(include_kroonsteen)
subtraction_2 = Subtraction(KroonsteenBreedte=kroonsteen_breedte, B=multiplication)
rectangle = Rectangle(Plane=PlaneXY(0, 0, 0), XSize=subtraction_2, YSize=subtraction, Radius=0)  # -> Rectangle, Length
num_2 = Number(2)
explode = Explode(Curve=rectangle.Rectangle, Recursive=True)  # -> Segments, Vertices
num_3 = Number(3)
num_4 = Number(1)
num_5 = Number(0)
num_6 = Number(2)
item = ListItem(List=explode.Segments, Index=[num_3, num_5, num_2], Wrap=True)
division = Division(A=subtraction_2, B=num_6)
join = JoinCurves(Curves=item, Preserve=False)
item_2 = ListItem(List=explode.Segments, Index=num_4, Wrap=True)
fillet = Fillet(Curve=join, Radius=division)
group = Group(Objects=[fillet, item_2])
graft = GraftTree(Tree=group, IncludeEmptyLists=True, IncludeNullItems=True)
ungroup = Ungroup(Group=graft)
join_2 = JoinCurves(Curves=ungroup, Preserve=False)
p_n_c = PickNChoose(Pattern=include_kroonsteen_2, Stream1=join_2)
R = ClusterOutput(p_n_c)

# ==== cluster RepositionTopLusterTerminal
kerf = ClusterInput()
dts_radius = ClusterInput()
part_interspacing = ClusterInput()
kr_x = ClusterInput()
rib_width = ClusterInput()
num_ribs = ClusterInput()
kr_y = ClusterInput()
rib_y = ClusterInput()
dts_margin = ClusterInput()
calc_x_movement = Evaluate(
    F="(part_interspacing+DTS_radius+rib_width)*(num_ribs-1)-0.5*kr_x",
    kr_x=kr_x,
    part_interspacing=part_interspacing,
    rib_width=rib_width,
    num_ribs=num_ribs,
    DTS_radius=dts_radius,
    kerf=kerf)
calc_y_movement = Evaluate(F="(-kr_y-rib_y-DTS_margin)/2", kr_y=kr_y, rib_y=rib_y, DTS_margin=dts_margin)
single_cutout = ClusterInput()
vec = VectorXYZ(XComponent=calc_x_movement, YComponent=calc_y_movement, ZComponent=0)  # -> Vector, Length
move = Move(SingleCutout=single_cutout, Motion=vec.Vector)  # -> TopKroonsteen, Transform
top_kroonsteen = ClusterOutput(move.TopKroonsteen)

# ==== cluster RepositionBottomLusterTerminal
rib_y = ClusterInput()
dts_fiber_margin = ClusterInput()
kr_y = ClusterInput()
kr_x = ClusterInput()
calc_y_movement = Evaluate(F="(-kr_y+rib_y+DTS_fiber_margin)/2", kr_y=kr_y, rib_y=rib_y, DTS_fiber_margin=dts_fiber_margin)
calc_x_movement = Evaluate(F="-0.5*kr_x", kr_x=kr_x)
vec = VectorXYZ(XComponent=calc_x_movement, YComponent=calc_y_movement, ZComponent=0)  # -> Vector, Length
single_cutout = ClusterInput()
move = Move(SingleCutout=single_cutout, Motion=vec.Vector)  # -> BotKroonsteen, Transform
bot_kroonsteen = ClusterOutput(move.BotKroonsteen)

# ==== cluster CheckBboxSize
C = ClusterInput()
bbox = BoundingBox(Content=C, Plane=PlaneXY(0, 0, 0))  # -> Box, Box_2
debox = DeconstructBox(Box=bbox.Box)  # -> Plane, X, Y, Z
dedomain = DeconstructDomain(Domain=debox.X)  # -> Start, End
dedomain_2 = DeconstructDomain(Domain=debox.Y)  # -> Start, End
subtraction = Subtraction(A=dedomain.End, B=dedomain.Start)
subtraction_2 = Subtraction(A=dedomain_2.End, B=dedomain_2.Start)
R = ClusterOutput(subtraction)
R_2 = ClusterOutput(subtraction_2)

# ==== cluster GenerateSupportRing_2
kerf = ClusterInput()
rib_width = ClusterInput()
polygon_smoothing_radius = ClusterInput()
two = Number(2)
coil_radius = ClusterInput()
kerf_2 = Number(kerf)
division = Division(RibWidth=rib_width, B=two)
number_of_support_ribs = ClusterInput()
support_ring_thickness = ClusterInput()
addition = Addition(CoilRadius=coil_radius, B=division)
subtraction = Subtraction(A=addition, SupportRingThickness=support_ring_thickness)
addition_2 = Addition(A=addition, Kerf=kerf_2)
polygon = Polygon(
    Plane=PlaneXY(0, 0, 0),
    Radius=addition_2,
    NumberOfSupportRibs=number_of_support_ribs,
    PolygonSmoothingRadius=polygon_smoothing_radius)  # -> Polygon, Length
subtraction_2 = Subtraction(A=subtraction, Kerf=kerf_2)
polygon_2 = Polygon(Plane=PlaneXY(0, 0, 0), Radius=subtraction_2, Segments=number_of_support_ribs, FilletRadius=polygon_smoothing_radius)  # -> Polygon, Length
rbig = ClusterOutput(addition_2)
join = JoinCurves(Curves=[polygon.Polygon, polygon_2.Polygon], Preserve=False)
bbox = BoundingBox(Content=polygon.Polygon, Plane=PlaneXY(0, 0, 0))  # -> Box, Box_2
graft = GraftTree(Tree=join, IncludeEmptyLists=True, IncludeNullItems=True)
debox = DeconstructBox(Box=bbox.Box)  # -> Plane, PolygonSize, Y, Z
dedomain = DeconstructDomain(Domain=debox.PolygonSize)  # -> Start, PolygonXSize
polygon_x_size = ClusterOutput(dedomain.PolygonXSize)
T = ClusterOutput(graft)

# ==== cluster GenerateRibCut_2
kerf = ClusterInput()
material_thickness = ClusterInput()
rib_length_x = ClusterInput()
kerf_2 = Number(kerf)
ring_distance_from_edge = ClusterInput()
num = Number(2)
num_2 = Number(2)
num_3 = Number(1)
division = Division(RibLengthX=rib_length_x, B=num_3)
multiplication = Multiplication(Kerf=kerf_2, B=num)
division_2 = Division(RingDistance=ring_distance_from_edge, B=num_2)
subtraction = Subtraction(MaterialThickness=material_thickness, B=multiplication)
subtraction_2 = Subtraction(A=division, B=division_2)
subtraction_3 = Subtraction(A=subtraction_2, B=kerf_2)
eval = Evaluate(F="-x-kerf", x=division, kerf=kerf_2)
half_x_min_kerf = ClusterOutput(subtraction_3)
rectangle = Rectangle(Plane=PlaneXY(0, 0, 0), XSize=subtraction_3, YSize=subtraction, Radius=0)  # -> Rectangle, Length
vec = VectorXYZ(XComponent=eval, YComponent=0, ZComponent=0)  # -> Vector, Length
rectangle_2 = Curve(rectangle.Rectangle)
rectangle_3 = ClusterOutput(rectangle_2)
material_thickness_min_kerf = ClusterOutput(subtraction)
move = Move(Geometry=rectangle_2, Motion=vec.Vector)  # -> SingleCutout, Transform
single_cutout = ClusterOutput(move.SingleCutout)

# ==== cluster GenerateRingCutout_2
material_thickness_min_kerf = ClusterInput()
crv = ClusterInput()
rbig = ClusterInput()
half_x_min_kerf = ClusterInput()
_0_5 = Number(-0.5)
number_of_ribs = ClusterInput()
polygon_x_size = ClusterInput()
crv_2 = Curve(crv)
multiplication = Multiplication(MaterialThicknessMinKerf=material_thickness_min_kerf, B=_0_5)
subtraction = Subtraction(Rbig=rbig, HalfXMinKerf=half_x_min_kerf)
subtraction_2 = Subtraction(A=subtraction)
mirror = Mirror(Geometry=crv_2, Plane=PlaneYZ(0, 0, 0))  # -> Geometry, Transform
vec = VectorXYZ(PolygonXSize=polygon_x_size, YComponent=multiplication, ZComponent=0)  # -> Vector, Length
move = Move(RectangleCutout=mirror.Geometry, Motion=vec.Vector)  # -> Geometry, Transform
arrpolar = PolarArray(Geometry=move.Geometry, Plane=PlaneXY(0, 0, 0), NumberOfRibs=number_of_ribs, Angle=6.283185307)  # -> RingCutoutArray, Transform
ring_cutout_array = ClusterOutput(arrpolar.RingCutoutArray)
